vi "Alamouti_RX_student.gvi"   [LabVIEW NXG]
inputs:
  "Modulation Parameters In": T6 = {"Modulation Type"="QPSK", "Control Information\nfor Packet Header/Tail"={"Training Sequence 1 (derived)"=[], "Zero Pad Length"=0, "Training Sequence 2 (derived)"=[]}, "RX Oversample Factor"=20, "Synchronization Options"={"Synchronization Method"="Timing Estimation", "Fixed Offset"=0, "Symbol Timing Recovery Method"="Max Energy", "Frame Detection Method"="Sliding Correlator", "Correct Frequency Offset"=FALSE}, "Number of Data Symbols (Derived)"=250, "RX Sample Rate"=4000000, "Pulse Shaping Parameters"={"Modulation Type"="PSK", "Pulse Shaping Filter"="Raised Cosine", "Filter Parameter"=0.5, "Filter Length (Symbols)"=8}, "Channel Estimation/Equalization Parameters"={"Equalization Method"="Direct", "Channel Estimate Length"=4, "Equalizer Length"=4, "Equalizer Delay"=-1}}
  "Input Complex Symbols 1": c128[]
  "Input Complex Symbols 2": c128[]
  "Channel estimates": T7
  "error in (no error)": error
outputs:
  "Output Complex Symbols": c128[]
  "Modulation Parameters Out": T6
  "error out": error
types:
  T1 = cluster{"Training Sequence 1 (derived)": c128[], "Zero Pad Length": i32, "Training Sequence 2 (derived)": c128[]}
  T2 = cluster{"Synchronization Method": string, "Fixed Offset": i32, "Symbol Timing Recovery Method": string, "Frame Detection Method": string, "Correct Frequency Offset": bool}
  T3 = enum{"none", "Raised Cosine", "Root Raised Cos", "Gaussian"}
  T4 = cluster{"Modulation Type": enum{"FSK", "PSK", "QAM", "MSK", "PAM", "ASK"}, "Pulse Shaping Filter": T3, "Filter Parameter": f64, "Filter Length (Symbols)": i32}
  T5 = cluster{"Equalization Method": string, "Channel Estimate Length": i32, "Equalizer Length": i32, "Equalizer Delay": i32}
  T6 = cluster{"Modulation Type": string, "Control Information\nfor Packet Header/Tail": T1, "RX Oversample Factor": i32, "Synchronization Options": T2, "Number of Data Symbols (Derived)": i32, "RX Sample Rate": f64, "Pulse Shaping Parameters": T4, "Channel Estimation/Equalization Parameters": T5}
  T7 = cluster{"Element 1": c128[], "Element 2": c128[], "Element 3": c128[], "Element 4": c128[]}
diagram:
  Property Node(instance in=$"Channel estimates") -> ("Element 1"=w1, "Element 2"=w2, "Element 3"=w3, "Element 4"=w4)
  # a0[k]
  Absolute Value(x=w1) -> w5
  Square(x=w5) -> w6
  # a1[k]
  Absolute Value(x=w2) -> w7
  Square(x=w7) -> w8
  Absolute Value(x=w3) -> w9
  # a2[k]
  Square(x=w9) -> w10
  Absolute Value(x=w4) -> w11
  # a3[k]
  Square(x=w11) -> w12
  Add(w6, w8, w10, w12) -> w13
  Array Size(array=$"Input Complex Symbols 1") -> (size(s)=w14)
  Divide(x=w14, y=128) -> w15
  Reshape Array(inArray=$"Input Complex Symbols 1", size=w15, size=128) -> w16
  # R2[k], R6[k]
  for (N = w15) (iteration -> i1) {
    Multiply(2, i1) -> w17
    Array Index(array=w16) -> (out0[w17, _]=w18)
    Multiply(2, i1) -> w19
    Increment(x=w19) -> w20
    Array Index(array=w16) -> (out0[w20, _]=w21)
  }
  # R0[k],R4[k]
  # R1[k],R5[k]
  Complex Conjugate(x + iy=w21) -> w22
  Array Size(array=w22) -> (size(s)=w23)
  Divide(x=w23, y=128) -> w24
  call "Repeat.gvi"(Array=w2, Numeric=w24) -> (output array=w25)
  Multiply(w25, w22) -> w26
  Array Size(array=$"Input Complex Symbols 2") -> (size(s)=w27)
  Divide(x=w27, y=128) -> w28
  Reshape Array(inArray=$"Input Complex Symbols 2", size=w28, size=128) -> w29
  # R3[k],R7[k]
  for (N = w28) (iteration -> i2) {
    Multiply(2, i2) -> w30
    Array Index(array=w29) -> (out0[w30, _]=w31)
    Multiply(2, i2) -> w32
    Increment(x=w32) -> w33
    Array Index(array=w29) -> (out0[w33, _]=w34)
  }
  # H1[k]*
  # H2[k]*
  Complex Conjugate(x + iy=w3) -> w35
  Array Size(array=w31) -> (size(s)=w36)
  Divide(x=w36, y=128) -> w37
  call "Repeat.gvi"(Array=w35, Numeric=w37) -> (output array=w38)
  Multiply(w38, w31) -> w39
  # Ho[k]*
  Complex Conjugate(x + iy=w1) -> w40
  Array Size(array=w18) -> (size(s)=w41)
  Divide(x=w41, y=128) -> w42
  call "Repeat.gvi"(Array=w40, Numeric=w42) -> (output array=w43)
  Multiply(w43, w18) -> w44
  Complex Conjugate(x + iy=w34) -> w45
  Array Size(array=w45) -> (size(s)=w46)
  Divide(x=w46, y=128) -> w47
  call "Repeat.gvi"(Array=w4, Numeric=w47) -> (output array=w48)
  Multiply(w48, w45) -> w49
  # ~s0,~s2,~s4
  Add(w44, w26, w39, w49) -> w50
  Array Size(array=w22) -> (size(s)=w51)
  Divide(x=w51, y=128) -> w52
  call "Repeat.gvi"(Array=w1, Numeric=w52) -> (output array=w53)
  Multiply(w53, w22, -1+0i) -> w54
  # H3[k]*
  Complex Conjugate(x + iy=w4) -> w55
  Array Size(array=w31) -> (size(s)=w56)
  Divide(x=w56, y=128) -> w57
  call "Repeat.gvi"(Array=w55, Numeric=w57) -> (output array=w58)
  Multiply(w58, w31) -> w59
  Array Size(array=w45) -> (size(s)=w60)
  Divide(x=w60, y=128) -> w61
  call "Repeat.gvi"(Array=w3, Numeric=w61) -> (output array=w62)
  Multiply(w62, w45, -1+0i) -> w63
  Complex Conjugate(x + iy=w2) -> w64
  Array Size(array=w18) -> (size(s)=w65)
  Divide(x=w65, y=128) -> w66
  call "Repeat.gvi"(Array=w64, Numeric=w66) -> (output array=w67)
  # ~s1,~s3,~s5
  Multiply(w67, w18) -> w68
  Add(w68, w54, w59, w63) -> w69
  Interleave Array(w50, w69) -> w70
  Divide(x=w70, y=w13) -> w71
  $"Output Complex Symbols" <- w71
  $"error out" <- $"error in (no error)"
  $"Modulation Parameters Out" <- $"Modulation Parameters In"
